# Dynamo graph TIES.dyn (Dynamo 2.1.0.7500)

python_script = Python()  # unwired: IN[0]
# ---------- python_script.python (197 lines) ----------
# Load the Python Standard and DesignScript Libraries
import sys
import math
import clr
from itertools import chain
clr.AddReference('ProtoGeometry')
from Autodesk.DesignScript.Geometry import *
import Autodesk
from itertools import islice


# The inputs to this node will be stored as a list in the IN variables.
dataEnteringNode = IN

#""" Global Variables"""
#b = int(input('please enter column's b length: '))
b = 1500
#h = int(input('please enter column's h length: '))
h = 500
#bp = list(range(int(input("please enter column's b side rebar number: "))))
bPoints = list(range(15))
_bPoints = bPoints[:]
#hp = list(range(int(input("please enter column's h side rebar number: "))))
hPoints = list(range(4))
_hPoints = hPoints
#sp = int(input("please enter v-spacing criteria: "))
sp = 150
#hlen = int(input("Please enter h length criteria: "))
bMin = 600

clearCover = 40
vDia = 25
hDia = 12
vCover = clearCover+hDia+(vDia/2.0)
hCover = clearCover+(hDia/2.0)

asp = (b-(2*vCover))/float(len(bPoints)-1)

#----------------------------------------------------------
""" DYNAMO-PYTHON Geometry Function """
def slc_2(l):
	a = l[::2]
	n = 2 
	final = [a[i * n:(i + 1) * n] for i in range((len(a) + n - 1) // n )]  
	return slc(a, n)
def slc(lst): #to slice vertical rebar list into pattern.
	patt = [3,1,3,1,3,1,3,1,3,1,3,1,3,1,3,1,3,1,3,1,3,1,3,1,3,1,3]
	it = iter(lst)
	sliced =[list(islice(it, 0, i)) for i in patt]
	for i in sliced[::-1]:
	    if i == []:
        	sliced.remove(i)
	return sliced
# Concrete Column
basePoint = Point.ByCoordinates(0, 0, 0)
def column(basePoint, b, h):
	p1 = basePoint
	p2 = Geometry.Translate(p1, Vector.XAxis(), b)
	p3 = Geometry.Translate(p2, Vector.YAxis(), h)
	p4 = Geometry.Translate(p3, Vector.XAxis(), -b)
	lp = [p1, p2, p3, p4]
	pl = Polygon.ByPoints(lp)
	return pl, lp
#Driver
column = column(basePoint, b, h)

# Vertical Rebar Distribution
def vRebar(basePoint, vCover, hCover, bPoints, hPoints, b, h):
	_p = Geometry.Translate(basePoint, Vector.ByCoordinates(vCover, vCover, 0))
	absp = (b-(2*vCover))/(len(bPoints)-1)
	dabsp = absp
	ahsp = (h-(2*vCover))/(len(hPoints)-1)
	dahsp = ahsp
	lbp = [_p]
	_lbp = []
	lhp = [_p]
	_lhp = []
	for nb in range(len(bPoints)-1):
		lbp.append(Geometry.Translate(_p, Vector.ByCoordinates(dabsp, 0, 0)))
		dabsp += absp
	for _nb in lbp:
		_lbp.append(Geometry.Translate(_nb, Vector.ByCoordinates(0, h-(2*vCover), 0)))
	for nh in range(len(hPoints)-1):
		lhp.append(Geometry.Translate(_p, Vector.ByCoordinates(0, dahsp, 0)))
		dahsp += ahsp
	for _nh in lhp:
		_lhp.append(Geometry.Translate(_nh, Vector.ByCoordinates(b-(2*vCover), 0, 0)))
	return lbp[1:-1], _lbp[1:-1], lhp, _lhp

#Driver
vRebars = vRebar(basePoint, vCover, hCover, bPoints, hPoints, b, h)

# Get rebars of same position in the opposit list
def getTwin(vRebar, pureb_leftRebar, currentRebars, side):
	vRebars = vRebar(basePoint, vCover, hCover, bPoints, hPoints, b, h)
	vRebarsbPointsList = vRebars[0]
	vRebars_bPointsList = vRebars[1]
	vRebarshPointsList = vRebars[2]
	vRebars_hPointsList = vRebars[3]

	if len(pureb_leftRebar) == 1:
		temp1 = currentRebars[:]
		oppositRebars = []
		for i in temp1:
			if side == 'b':
				ti = vRebarsbPointsList.index(i)
				t = vRebars_bPointsList[ti]
				oppositRebars.append(t)
		return oppositRebars
	elif len(pureb_leftRebar) >= 2:
		temp1 = list(chain.from_iterable(currentRebars))
		temp2 = []
		n = len(currentRebars[0])
		for l in temp1:
			li = temp1.index(l)
			if side == 'b':
				ti = vRebarsbPointsList.index(l)
				t = vRebars_bPointsList[ti]
				temp2.append(t)
		oppositRebars = [temp2[i:i + n] for i in range(0, len(temp2), n)]
		return oppositRebars
	
# Getting Stirrup's curves from Pure Points:
def getCurve(stirrupPoints):
	currentPoints = stirrupPoints[0]
	twinPoints = stirrupPoints[1]
	purePoints = [currentPoints, twinPoints]
	try:
		for lst in twinPoints:
			list.reverse(lst)
		purePoints_transposed = list(map(list, zip(*purePoints)))
		flattened = []
		for i in purePoints_transposed:
			flattened.append(list(chain.from_iterable(i)))
		return flattened
	except: #for single pure rebar per one half of a side
		list.reverse(twinPoints)
		flattened = []
		flattened.append(list(chain.from_iterable(purePoints)))
		return flattened
# Conditioning Grouping:
def tie(p, vCover, hCover, bPoints, hPoints, b, h):
	vRebars = vRebar(p, vCover, hCover, bPoints, hPoints, b, h)
	vRebarsbPointsList = vRebars[0]
	#if len(vr[0]%2 != 0:
	bHalf = len(vRebarsbPointsList)/2
	b_leftRebar = vRebarsbPointsList[:bHalf]
	b_rightRebar = vRebarsbPointsList[bHalf+1:][::-1]
	pureb_leftRebar = b_leftRebar[3:]
	pureb_rightRebar = b_rightRebar[3:]
	bMid = vRebarsbPointsList[bHalf]
	if len(pureb_leftRebar) == 1:
		b_vRebarTie = list((pureb_leftRebar[-1], pureb_rightRebar[-1]))
		_b_vRebarTie = getTwin(vRebar,pureb_leftRebar, b_vRebarTie, 'b')
		return b_vRebarTie, _b_vRebarTie
	elif len(pureb_leftRebar) == 2:
		b_vRebarTie = list((pureb_leftRebar[-2:], pureb_rightRebar[-2:]))
		_b_vRebarTie = getTwin(vRebar, pureb_leftRebar, b_vRebarTie, 'b')
		return b_vRebarTie, _b_vRebarTie
	elif len(pureb_leftRebar) == 3:
		b_vRebarTie = list((pureb_leftRebar[::2], pureb_rightRebar[::2]))
		_b_vRebarTie = getTwin(vRebar, pureb_leftRebar, b_vRebarTie, 'b')
		return b_vRebarTie, _b_vRebarTie
	#elif len(pureb_leftRebar) > 3:
		#a = slc(pureb_leftRebar)
		#lenLast = len(a[-1])
		#lenBeforeLast = len(a[-2])
		#b_vRebarTie = []
		#if lenLast == 1 and lenBeforeLast == 3:
			#for i in a:
				#while len(i) == 3:
					#b_vRebarTie.append(3)
			#return b_vRebarTie
			#return 'Error'
		#elif lenLast == 1 and lenBeforeLast == 1:
			#return a, 1, 1
		#elif lenLast == 2 and lenBeforeLast == 1:
			#return a, 2, 1
		#else: # EenlyDivided 3's
			#return a, 3, 1
		#if len(slc(pureb_leftRebar, 3)[-1]) == 1:
			#ind = list((plr[::2], prr[::2]))
			#ind.append([mid])
		#return a, lenLast, lenBeforeLast#len(slc(a, 3)[-1])
		#elif ((len(plr)-1) - plr.index(plr[::2][-1])) == 2:
			#ind = list((plr[::2])[-1])#, prr[::2]))
			#ind.append(list((plr[-1], prr[-1])))
			#return ind
		#return 2 #((len(plr)-1) - plr.index(plr[::2][-1]))"""
		#return mid
		
#----------------------------------
#OUT = column, vRebars, asp
stirrups =  tie(basePoint, vCover, hCover, bPoints, hPoints, b, h)
#OUT = stirrups
#OUT = getTwin(vRebar, 1, 3)
OUT = getCurve(stirrups), column, vRebars
# ----------------------------------------
code_block = CodeBlock(a=python_script) { a[0]; }
boolean = BoolSelector(true)
byPoints = PolyCurve.ByPoints(points=code_block, connectLastToFirst=boolean)
code_block_2 = CodeBlock(a=code_block) { a[0]; }
