# Dynamo graph TIES.dyn (Dynamo 2.1.0.7500)

code_block = CodeBlock { a[0]; a[1]; }  # unwired: a
test_output = CodeBlock(t3=code_block.out1, t5=code_block.out0)
# ---------- test_output.designscript (9 lines) ----------
t2 = List.Flatten(t3, -1);
vector1 = Vector.ByCoordinates(0, 0, -10000);
stirrup = (0..10000..150);
vector2 = Vector.ByCoordinates(0, 0, -stirrup);
geometry1 = Geometry.Translate(t2, vector1);
line1 = Line.ByStartPointEndPoint(t2, geometry1);
polyCurve1 = PolyCurve.ByPoints(t5, true);
geometry2 = Geometry.Translate(polyCurve1<1>, vector2<2>);
a = vector2;
# ----------------------------------------
b_side_rebars = IntegerSlider(21, range=1..500 step 1)
h_side_rebars = IntegerSlider(4, range=1..7 step 1)
spacing = IntegerSlider(150, range=1..600 step 1)
python_script = Python(IN[0]=b_side_rebars, IN[1]=h_side_rebars, IN[2]=spacing)
# ---------- python_script.python (364 lines) ----------
# Load the Python Standard and DesignScript Libraries
import sys
import math
import clr
from itertools import chain
clr.AddReference('ProtoGeometry')
from Autodesk.DesignScript.Geometry import *
import Autodesk
from itertools import islice


# The inputs to this node will be stored as a list in the IN variables.
dataEnteringNode = IN

#""" Global Variables"""
#b = int(input('please enter column's b length: '))
bLen = 1500
#h = int(input('please enter column's h length: '))
hLen = 400
#bp = list(range(int(input("please enter column's b side rebar number: "))))
bRange = list(range(IN[0]))
_bRange = bRange[:]
#hp = list(range(int(input("please enter column's h side rebar number: "))))
hRange = list(range(IN[1]))
_hRange = hRange[:]
#sp = int(input("please enter v-spacing criteria: "))
sp = IN[2]
#hlen = int(input("Please enter h length criteria: "))
bMin = 600

cc = 40
vDia = 25
hDia = 12
vCover = cc+hDia+(vDia/2.0)
hCover = cc+(hDia/2.0)
asp = (bLen-(2*vCover))/float(len(bRange)-1)
basePoint = Point.ByCoordinates(0, 0, 0)
vAttribute = {'basePoint': basePoint,'clearCover': cc, 'vCover': vCover, 'hCover': hCover, 'bRange': bRange, 
'_bRange': _bRange, 'hRange': hRange, '_hRange': _hRange, 'bLen': bLen, 'hLen': hLen, 'spacing': sp, 'actualSpacing': asp}
#----------------------------------------------------------
""" DYNAMO-PYTHON Geometry Function """
def slc(lst, attribute_Dict): #to slice vertical rebar list into pattern.
	if attribute_Dict['spacing'] <= 150:
		pattRange = 3
	else:
		pattRange = 2
	div = [pattRange, 1]
	patt = (len(lst)//2)*div
	it = iter(lst)
	sliced =[list(islice(it, 0, i)) for i in patt]
	for i in sliced[::-1]:
	    if i == []:
        	sliced.remove(i)
	return sliced
# Concrete Column


def column(attribute_Dict):
	p1 = vAttribute['basePoint']
	p2 = Geometry.Translate(p1, Vector.XAxis(), vAttribute['bLen'])
	p3 = Geometry.Translate(p2, Vector.YAxis(), vAttribute['hLen'])
	p4 = Geometry.Translate(p3, Vector.XAxis(), -vAttribute['bLen'])
	lp = [p1, p2, p3, p4]
	pl = Polygon.ByPoints(lp)
	return pl, lp

# Vertical Rebar Distribution
def vRebar(attribute_Dict):#basePoint, vCover, hCover, bPoints, hPoints, b, h):
	_p = Geometry.Translate(vAttribute['basePoint'], Vector.ByCoordinates(vAttribute['vCover'], vAttribute['vCover'], 0))
	absp = (vAttribute['bLen']-(2*vAttribute['vCover']))/(len(vAttribute['bRange'])-1)
	dabsp = absp
	ahsp = (vAttribute['hLen']-(2*vAttribute['vCover']))/(len(vAttribute['hRange'])-1)
	dahsp = ahsp
	lbp = [_p]
	_lbp = []
	lhp = [_p]
	_lhp = []
	for nb in range(len(vAttribute['bRange'])-1):
		lbp.append(Geometry.Translate(_p, Vector.ByCoordinates(dabsp, 0, 0)))
		dabsp += absp
	for _nb in lbp:
		_lbp.append(Geometry.Translate(_nb, Vector.ByCoordinates(0, vAttribute['hLen']-(2*vAttribute['vCover']), 0)))
	for nh in range(len(vAttribute['hRange'])-1):
		lhp.append(Geometry.Translate(_p, Vector.ByCoordinates(0, dahsp, 0)))
		dahsp += ahsp
	for _nh in lhp:
		_lhp.append(Geometry.Translate(_nh, Vector.ByCoordinates(vAttribute['bLen']-(2*vAttribute['vCover']), 0, 0)))
	vertical = {'bPoints': lbp[1:-1],'_bPoints': _lbp[1:-1], 'hPoints': lhp, '_hPoints': _lhp}
	return vertical

# Get rebars of same position in the opposit list
def getTwin(vertical_Dict, range_to_check, currentRebars, side):
	if len(range_to_check['pureb_left']) == 0:
		temp1 = currentRebars[:]
		oppositRebars = []
		for i in temp1:
			if side == 'b':
				ti = vertical_Dict['bPoints'].index(i)
				t = vertical_Dict['_bPoints'][ti]
				oppositRebars.append(t)
		return oppositRebars
	if len(range_to_check['pureb_left']) == 1:
		temp1 = currentRebars[:]
		oppositRebars = []
		for i in temp1:
			if side == 'b':
				ti = vertical_Dict['bPoints'].index(i)
				t = vertical_Dict['_bPoints'][ti]
				oppositRebars.append(t)
		return oppositRebars
	elif len(range_to_check['pureb_left']) >= 2:
		temp1 = list(chain.from_iterable(currentRebars))
		temp2 = []
		n = len(currentRebars[0])
		for l in temp1:
			li = temp1.index(l)
			if side == 'b':
				ti = vertical_Dict['bPoints'].index(l)
				t = vertical_Dict['_bPoints'][ti]
				temp2.append(t)
		oppositRebars = [temp2[i:i + n] for i in range(0, len(temp2), n)]
		return oppositRebars
	
# Getting Stirrup's curves from Pure Points:
def getCurve(stirrupPoints):
	currentPoints = stirrupPoints[0]
	twinPoints = stirrupPoints[1]
	purePoints = [currentPoints, twinPoints]
	try:
		for lst in twinPoints:
			list.reverse(lst)
		purePoints_transposed = list(map(list, zip(*purePoints)))
		flattened = []
		for i in purePoints_transposed:
			flattened.append(list(chain.from_iterable(i)))
		return flattened
	except: #for single pure rebar per one half of a side
		list.reverse(twinPoints)
		flattened = []
		flattened.append(list(chain.from_iterable(purePoints)))
		return flattened
# Conditioning Grouping:
# Main Function:
def stirrups(vertical_Dict, attribute_Dict, range_to_check):
	mainTies = tie(vertical_Dict, attribute_Dict, range_to_check)
	sideTies = tieSide(vertical_Dict, attribute_Dict)
	curves_mainTies = getCurve(mainTies)
	return curves_mainTies, sideTies
	if len(hPoints) <= 3:
		return curves_mainTies
	elif len(hPoints) >3:
		return curves_mainTies, sideTies

def tieSide(vertical_Dict, attribute_Dict):
	hHalf = len(vertical_Dict['hPoints'])/2
	h_leftRebar = vertical_Dict['hPoints'][:hHalf]
	h_rightRebar = vertical_Dict['hPoints'][hHalf+1:][::-1]
	pureh_Rebar = vertical_Dict['hPoints'][1:-1]
	
	leftMostB = vertical_Dict['bPoints'][0], vertical_Dict['_bPoints'][0]
	rightMostB = vertical_Dict['bPoints'][-1], vertical_Dict['_bPoints'][-1]
	h_mid = vertical_Dict['hPoints'][hHalf]
	h_vRebarTieTemp = []
	_h_vRebarTieTemp = []
	
	if len(vertical_Dict['hPoints']) == 4:
		h_vRebarTieTemp.append(vertical_Dict['hPoints'][1:-1])
		h_vRebarTieTemp.append(leftMostB[::-1])
		_h_vRebarTieTemp.append(vertical_Dict['_hPoints'][1:-1])
		_h_vRebarTieTemp.append(rightMostB[::-1])
		h_vRebarTie = [item for sublist in h_vRebarTieTemp for item in sublist]
		_h_vRebarTie = [item for sublist in _h_vRebarTieTemp for item in sublist]
		return h_vRebarTie, _h_vRebarTie
	elif len(vertical_Dict['hPoints']) == 5:
		h_vRebarTieTemp.append([vertical_Dict['hPoints'][2]])
		h_vRebarTieTemp.append(leftMostB[::-1])
		_h_vRebarTieTemp.append([vertical_Dict['_hPoints'][2]])
		_h_vRebarTieTemp.append(rightMostB[::-1])
		h_vRebarTie = [item for sublist in h_vRebarTieTemp for item in sublist]
		_h_vRebarTie = [item for sublist in _h_vRebarTieTemp for item in sublist]
		return h_vRebarTie, _h_vRebarTie
	elif len(vertical_Dict['hPoints']) == 6 or len(vertical_Dict['hPoints']) == 7:
		h_vRebarTieTemp.append(vertical_Dict['hPoints'][2:-2])
		h_vRebarTieTemp.append(leftMostB[::-1])
		_h_vRebarTieTemp.append(vertical_Dict['_bPoints'][2:-2])
		_h_vRebarTieTemp.append(rightMostB[::-1])
		h_vRebarTie = [item for sublist in h_vRebarTieTemp for item in sublist]
		_h_vRebarTie = [item for sublist in _h_vRebarTieTemp for item in sublist]
		return h_vRebarTie, _h_vRebarTie

# Determine what range to look at for applying stirrups condition according to side rebars number
def check_range(vertical_Dict, attribute_Dict):
	bHalf = len(vertical_Dict['bPoints'])/2
	b_mid = vertical_Dict['bPoints'][bHalf]
	if attribute_Dict['spacing'] <= 150:
		if len(attribute_Dict['hRange']) <= 3:
			b_first = 1
		else:
			b_first = 2
	else:
		if len(attribute_Dict['hRange']) <= 3:
			b_first = 0
		else:
			b_first = 1

	if len(vertical_Dict['bPoints'])%2 != 0:
		b_leftRebar = vertical_Dict['bPoints'][:bHalf]
		b_rightRebar = vertical_Dict['bPoints'][bHalf+1:][::-1]
	else:
		b_leftRebar = vertical_Dict['bPoints'][:bHalf]
		b_rightRebar = vertical_Dict['bPoints'][bHalf:][::-1]

	pureb_left = b_leftRebar[b_first:]
	pureb_right = b_rightRebar[b_first:]
	pure = {'pureb_left': pureb_left, 'pureb_right': pureb_right, 'b_mid': b_mid}
	return pure

def tie(vertical_Dict, attribute_Dict, range_to_check):
	if len(vertical_Dict['bPoints'])%2 != 0:	#Odd Number
		return tieOdd(vertical_Dict, attribute_Dict, range_to_check)
	else:						#Even Number
		return tieEven(vertical_Dict, attribute_Dict, range_to_check)

def tieOdd(vertical_Dict, attribute_Dict, range_to_check):
	if len(range_to_check['pureb_left']) <= 3:
		return tieOdd1(vertical_Dict, attribute_Dict, range_to_check)
	else:
		return tieOdd2(vertical_Dict, attribute_Dict, range_to_check)

def tieEven(vertical_Dict, attribute_Dict, range_to_check):
	if len(range_to_check['pureb_left']) <= 3:
		return tieEven1(vertical_Dict, attribute_Dict, range_to_check)
	else:
		return tieEven2(vertical_Dict, attribute_Dict, range_to_check)

def tieOdd1(vertical_Dict, attribute_Dict, range_to_check):
	if len(range_to_check['pureb_left']) == 0:
		b_vRebarTie = [range_to_check['b_mid']]
		_b_vRebarTie = getTwin(vertical_Dict, range_to_check, b_vRebarTie, 'b')
		return b_vRebarTie, _b_vRebarTie
	if len(range_to_check['pureb_left']) == 1:
		b_vRebarTie = list((range_to_check['pureb_left'][-1], range_to_check['pureb_right'][-1]))
		_b_vRebarTie = getTwin(vertical_Dict, range_to_check, b_vRebarTie, 'b')
		return b_vRebarTie, _b_vRebarTie
	elif len(range_to_check['pureb_left']) == 2:
		b_vRebarTie = list((range_to_check['pureb_left'][-2:], range_to_check['pureb_right'][-2:]))
		_b_vRebarTie = getTwin(vertical_Dict, range_to_check, b_vRebarTie, 'b')
		return b_vRebarTie, _b_vRebarTie
	elif len(range_to_check['pureb_left']) == 3:
		b_vRebarTie = list((range_to_check['pureb_left'][::2], range_to_check['pureb_right'][::2]))
		_b_vRebarTie = getTwin(vertical_Dict, range_to_check, b_vRebarTie, 'b')
		return b_vRebarTie, _b_vRebarTie

def tieEven1(vertical_Dict, attribute_Dict, range_to_check):	
	if len(range_to_check['pureb_left']) == 0:
		b_vRebarTie = list((range_to_check['pureb_left'][-1], range_to_check['pureb_right'][-1]))
		_b_vRebarTie = getTwin(vertical_Dict, range_to_check, b_vRebarTie, 'b')
		return b_vRebarTie, _b_vRebarTie
	elif len(range_to_check['pureb_left']) == 1:
		b_vRebarTie = list((range_to_check['pureb_left'][-1], range_to_check['pureb_right'][-1]))
		_b_vRebarTie = getTwin(vertical_Dict, range_to_check, b_vRebarTie, 'b')
		return b_vRebarTie, _b_vRebarTie
	elif len(range_to_check['pureb_left']) == 2 or len(range_to_check['pureb_left']) == 3:
		b_vRebarTie = list((range_to_check['pureb_left'][::len(range_to_check['pureb_left'])-1], range_to_check['pureb_right'][::len(range_to_check['pureb_right'])-1]))
		_b_vRebarTie = getTwin(vertical_Dict, range_to_check, b_vRebarTie, 'b')
		return b_vRebarTie, _b_vRebarTie

def tieOdd2(vertical_Dict, attribute_Dict, range_to_check):
	aLeft = slc(range_to_check['pureb_left'], attribute_Dict)
	aRight = slc(range_to_check['pureb_right'], attribute_Dict)
	lenLast = len(aLeft[-1])
	lenBeforeLast = len(aLeft[-2])
	b_vRebarTie = []
	if lenLast == 1 and lenBeforeLast == 3:			#17
		for i in aLeft:
			if len(i) == 3:
				b_vRebarTie.append([i[0], i[-1]])
		for i in aRight:
			if len(i) == 3:
				b_vRebarTie.append([i[0], i[-1]])
		b_vRebarTie.append([range_to_check['b_mid']])
		_b_vRebarTie = getTwin(vertical_Dict, range_to_check, b_vRebarTie, 'b')
		return b_vRebarTie, _b_vRebarTie
	elif lenLast == 1 and lenBeforeLast == 1:		#19
		for i in aLeft:
			if len(i) == 3:
				b_vRebarTie.append([i[0], i[-1]])
		b_vRebarTie.append(aLeft[-1])
		b_vRebarTie[-1].append(aRight[-1][0])
		for i in aRight:
			if len(i) == 3:
				b_vRebarTie.append([i[0], i[-1]])
		_b_vRebarTie = getTwin(vertical_Dict, range_to_check, b_vRebarTie, 'b')
		return b_vRebarTie, _b_vRebarTie
	else: 											#21 onward
		for i in aLeft:
			if len(i) == 3 or len(i) == 2:
				b_vRebarTie.append([i[0], i[-1]])
		for i in aRight:
			if len(i) == 3 or len(i) == 2:
				b_vRebarTie.append([i[0], i[-1]])
		_b_vRebarTie = getTwin(vertical_Dict, range_to_check, b_vRebarTie, 'b')
		return b_vRebarTie, _b_vRebarTie

def tieEven2(vertical_Dict, attribute_Dict, range_to_check):
	aLeft = slc(range_to_check['pureb_left'])
	aRight = slc(range_to_check['pureb_right'])
	lenLast = len(aLeft[-1])
	lenBeforeLast = len(aLeft[-2])
	b_vRebarTie = []

	if lenLast == 1 and lenBeforeLast == 3:			#17
		if len(aLeft) == 2:
			b_vRebarTie.append(aLeft[-2][0:2])
			b_vRebarTie.append(aLeft[-1])
			b_vRebarTie[-1].append(aRight[-1][0])
			b_vRebarTie.append(aRight[-2][0:2])
			_b_vRebarTie = getTwin(vertical_Dict, range_to_check, b_vRebarTie, 'b')
			return b_vRebarTie, _b_vRebarTie
		if len(aLeft) > 2:
			for i in aLeft[:-2]:
				if len(i) == 3:
					b_vRebarTie.append([i[0], i[-1]])
			b_vRebarTie.append(aLeft[-2][0:2])
			b_vRebarTie.append(aLeft[-1])
			b_vRebarTie[-1].append(aRight[-1][0])
			b_vRebarTie.append(aRight[-2][0:2])
			for i in aRight[:-2]:
				if len(i) == 3:
					b_vRebarTie.append([i[0], i[-1]])
			_b_vRebarTie = getTwin(vertical_Dict, range_to_check, b_vRebarTie, 'b')
			return b_vRebarTie, _b_vRebarTie
	elif lenLast == 1 and lenBeforeLast == 1:		#19
		for i in aLeft:
			if len(i) == 3:
				b_vRebarTie.append([i[0], i[-1]])
		b_vRebarTie.append(aLeft[-1])
		b_vRebarTie[-1].append(aRight[-1][0])
		for i in aRight:
			if len(i) == 3:
				b_vRebarTie.append([i[0], i[-1]])
		_b_vRebarTie = getTwin(vertical_Dict, range_to_check, b_vRebarTie, 'b')
		return b_vRebarTie, _b_vRebarTie
	else: 											#21 onward
		for i in aLeft:
			if len(i) == 3 or len(i) == 2:
				b_vRebarTie.append([i[0], i[-1]])
		for i in aRight:
			if len(i) == 3 or len(i) == 2:
				b_vRebarTie.append([i[0], i[-1]])
		_b_vRebarTie = getTwin(vertical_Dict, range_to_check, b_vRebarTie, 'b')
		return b_vRebarTie, _b_vRebarTie
#----------------------------------
# TESTING
column = column(vAttribute)
vRebars = vRebar(vAttribute)
pureRebars = check_range(vRebars, vAttribute)
ties = tie(vRebars, vAttribute, pureRebars)
links = stirrups(vRebars, vAttribute, pureRebars)
#OUT = check_range(vRebars, vAttribute)
#OUT = getTwin(vRebar, 1, 3)
OUT = ties
OUT = links, vRebars, column
#OUT = vAttribute, column, vRebars
# ----------------------------------------
code_block_2 = CodeBlock { true; }
byPoints = PolyCurve.ByPoints(points=python_script, connectLastToFirst=code_block_2)
T3 = CodeBlock { a[1]; }  # unwired: a
code_block_3 = CodeBlock(i=T3) { a = i[-1]; b = i[-2]; c = a[0]; d = a[-1]; e = b[0]; f = b[-1]; all = [c, d, f, e]; }
byPoints_2 = PolyCurve.ByPoints(points=code_block_3.all, connectLastToFirst=code_block_2)
T5 = CodeBlock(a=python_script) { a[0]; }
code_block_4 = CodeBlock(a=T5, b=T3) { [a, b]; }
